# Grasshopper definition RectangleWithMiter.gh (Grasshopper 1.0.7)

pt = Point(Point(380.5513898, 192.4258079, 0))
breadth = Slider(110, range=0..300)
sobject_length = GetNumber(Slider(343, range=0..2000), AtLeast=1, AtMost=1, Maximum=1.797693135e+308, Minimum=-1.797693135e+308, TreeAccess=False)
attracted_representation = GetPoint(pt, AtLeast=1, AtMost=1, Realtime=True, TreeAccess=False)
bias_t = GetNumber(Slider(0, range=0..1), AtLeast=1, AtMost=1, Maximum=1.797693135e+308, Minimum=-1.797693135e+308, TreeAccess=False)
neg = Negative(Value=breadth)
xy = XYPlane(Origin=Point(0, 0, 0))
X = UnitX(Factor=sobject_length)
X_2 = UnitX(Factor=neg)
Y = UnitY(Factor=breadth)
move = Move(Geometry=xy, Motion=Y)  # -> Geometry, Transform
addition = Addition(A=Y, B=X_2)
move_2 = Move(Geometry=xy, Motion=X)  # -> Geometry, Transform
move_3 = Move(Geometry=move_2.Geometry, Motion=addition)  # -> Geometry, Transform
merge = Merge(Data1=xy, Data2=move_2.Geometry, Data3=move_3.Geometry, Data4=move.Geometry, Data5=xy)
pline = PolyLine(Vertices=merge, Closed="True")
polylineport = PolyLinePort(polylineport=pline, attracted_pointofview=attracted_representation, bias_t=bias_t)  # -> attractionpoint_2, attraction_lineport_2
context_bake = ContextBake(AttractionPoint=polylineport.attractionpoint_2)
context_bake_2 = ContextBake(AttractionPort=polylineport.attraction_lineport_2)
context_bake_3 = ContextBake(SobjectShape=pline)

# ==== cluster PolyLinePort
polylineport = ClusterInput()
attracted_pointofview = ClusterInput()
bias_t = ClusterInput()
attracted_pointofview_2 = Point(attracted_pointofview)
polylineport_2 = Curve(polylineport)
bias_t_2 = Number(bias_t)
crv_cp = CurveClosestPoint(Point=attracted_pointofview_2, Curve=polylineport_2)  # -> Point, Parameter, Distance
explode = Explode(Curve=polylineport_2, Recursive=True)  # -> Segments, Vertices
trim = TrimTree(Tree=explode.Segments, Depth=1)
crv_cp_2 = CurveClosestPoint(Point=crv_cp.Point, Curve=trim)  # -> Point, Parameter, Distance
equalst = EqualityWithinTolerance(FirstNumber=crv_cp_2.Distance, SecondNumber="0", Tolerance=0.001)  # -> Equality, Inequality
dispatch = Dispatch(List=trim, DispatchPattern=equalst.Equality)  # -> ListA, ListB
eval = EvaluateCurve(Curve=reparameterize(dispatch.ListA), Parameter="0.5")  # -> Point, Tangent, Angle
dist = Distance(PointA=attracted_pointofview_2, PointB=eval.Point)
sort = SortList(Keys=dist, ValuesA=eval.Point, ValuesB=dispatch.ListA)  # -> Keys, ValuesA, ValuesB
item = ListItem(List=sort.ValuesA, Index=0, Wrap=True)
item_2 = ListItem(List=sort.ValuesB, Index=0, Wrap=True)
ln = Line(StartPoint=crv_cp.Point, EndPoint=item)
flip = FlipCurve(Curve=item_2, Guide=ln)  # -> Curve, Flag
eval_2 = EvaluateCurve(Curve=reparameterize(flip.Curve), Parameter=bias_t_2)  # -> Point, Tangent, Angle
attractionpoint = Point(eval_2.Point)
attraction_lineport = Line(item_2)
attractionpoint_2 = ClusterOutput(attractionpoint)
attraction_lineport_2 = ClusterOutput(attraction_lineport)
