# Grasshopper definition AttractionExample.gh (Grasshopper 1.0.7)
# plug-ins: Swiftlet, Hops, Human

panel = Panel("""C:\Git\Studium\PhD\semio\semio\tests\RectangleWithMiter.gh
http://localhost:6500/""")
panel_2 = Panel("""url
computeUrl
computeAuthToken""")
cjv = CreateJSONValue(Value=panel)
cjo = CreateJSONObject(Keys=panel_2, Values=cjv)
cjo_2 = CreateJSONObject(Keys="GrasshopperModuleProxy", Values=cjo)
sjt = StringifyJSONToken(JToken=cjo_2)
concat = Concatenate(FragmentA="http://127.0.0.1:5000", FragmentB="/", FragmentC="constructParameters")
concat_2 = Concatenate(FragmentA="http://127.0.0.1:5000", FragmentB="/", FragmentC="constructGrasshopperModuleProxy")
concat_3 = Concatenate(FragmentA="http://127.0.0.1:5000", FragmentB="/", FragmentC="constructSobject")
concat_4 = Concatenate(FragmentA="http://127.0.0.1:5000", FragmentB="/", FragmentC="constructAttraction")
concat_5 = Concatenate(FragmentA="http://127.0.0.1:5000", FragmentB="/", FragmentC="relativePointOfView")
concat_6 = Concatenate(FragmentA="http://127.0.0.1:5000", FragmentB="/", FragmentC="relativePointOfView")
concat_7 = Concatenate(FragmentA="http://127.0.0.1:5000", FragmentB="/", FragmentC="plane2Pose")
concat_8 = Concatenate(FragmentA="http://127.0.0.1:5000", FragmentB="/", FragmentC="pose2Plane")
cluster = Cluster(
    X=Slider(62, range=-1000..1000),
    Y=Slider(-22, range=-1000..1000),
    Z=Slider(0, range=-1000..1000),
    yaw=Slider(45, range=-360..360),
    pitch=Slider(-45, range=-360..360),
    roll=Slider(90, range=-360..360))
hops = Hops(
    _Path=concat,
    Names="Length",
    Values=Slider(440, range=0..1000),
    CacheResultsInMemory=True,
    CacheSolveResults=True,
    RemoteDefinitionLocation="http://127.0.0.1:5000/constructParameters",
    RemoteSolveVersion=(0, 1, 0),
    ShowInput_Enabled=False,
    ShowInput_Path=True,
    SynchronousSolve=True)
cluster_2 = Cluster(
    X=Slider(366, range=-1000..1000),
    Y=Slider(154, range=-1000..1000),
    Z=Slider(425, range=-1000..1000),
    yaw=Slider(-180, range=-360..360),
    pitch=Slider(0, range=-360..360),
    roll=Slider(-180, range=-360..360))
hops_2 = Hops(
    _Path=concat_2,
    Url="C:\Git\Studium\PhD\semio\semio\tests\RectangleWithMiter.gh",
    ComputeUrl="http://localhost:6500/",
    ComputeAuthToken=" ",
    CacheResultsInMemory=True,
    CacheSolveResults=True,
    RemoteDefinitionLocation="http://127.0.0.1:5000/constructGrasshopperModuleProxy",
    RemoteSolveVersion=(0, 1, 0),
    ShowInput_Enabled=False,
    ShowInput_Path=True,
    SynchronousSolve=True)
hops_3 = Hops(
    _Path=concat,
    Names="Length",
    Values=Slider(330, range=0..1000),
    CacheResultsInMemory=True,
    CacheSolveResults=True,
    RemoteDefinitionLocation="http://127.0.0.1:5000/constructParameters",
    RemoteSolveVersion=(0, 1, 0),
    ShowInput_Enabled=False,
    ShowInput_Path=True,
    SynchronousSolve=True)
hops_4 = Hops(
    CacheResultsInMemory=False,
    CacheSolveResults=False,
    RemoteSolveVersion=(0, 1, 0),
    ShowInput_Enabled=False,
    ShowInput_Path=True,
    SynchronousSolve=True)
hops_5 = Hops(
    _Path=concat_3,
    ModuleProxy=hops_2,
    Pose=cluster,
    Parameters=hops,
    Request=True,
    CacheResultsInMemory=False,
    CacheSolveResults=False,
    RemoteDefinitionLocation="http://127.0.0.1:5000/constructSobject",
    RemoteSolveVersion=(0, 1, 0),
    ShowInput_Enabled=False,
    ShowInput_Path=True,
    SynchronousSolve=True)  # -> SobjectJson, Geometry
hops_6 = Hops(
    _Path=concat_3,
    ModuleProxy=hops_2,
    Pose=cluster_2,
    Parameters=hops_3,
    Request=True,
    CacheResultsInMemory=False,
    CacheSolveResults=False,
    RemoteDefinitionLocation="http://127.0.0.1:5000/constructSobject",
    RemoteSolveVersion=(0, 1, 0),
    ShowInput_Enabled=False,
    ShowInput_Path=True,
    SynchronousSolve=True)  # -> SobjectJson, Geometry
pl2pl = MoveObjectPlaneToPlane(G=hops_6.Geometry, S=PlaneXY(0, 0, 0), T=cluster_2)  # -> TG; inputs S: Plane, T: Plane
# ---------- pl2pl: Python ----------
#Component Information
#--------------------------------------------------------------------------------------------
if ghenv.Component.RunCount<2:
    #General
    #--------------------------------------------------------------------------------------------
    __author__ = "Ueli Saluz"
    __version__ = "2022.12.10"
    
    ghenv.Component.Name = "MoveObjectPlaneToPlane"
    ghenv.Component.NickName = "Pl2Pl"
    ghenv.Component.Description = "Moves abitrary geometry from a source plane to a target plane."
    ghenv.Component.Message = "VER 1.1"
    ghenv.Component.Category = "Transform"
    ghenv.Component.SubCategory = "Euclidean"
    
     #Inputs
    #--------------------------------------------------------------------------------------------
    inputIndex=0
    
    ghenv.Component.Params.Input[inputIndex].Name = "Geometry"
    ghenv.Component.Params.Input[inputIndex].NickName = "G"
    ghenv.Component.Params.Input[inputIndex].Description = "Geometry to move."
    ghenv.Component.Params.Input[inputIndex].Optional = False
    inputIndex+=1
    
    ghenv.Component.Params.Input[inputIndex].Name = "SourcePlane"
    ghenv.Component.Params.Input[inputIndex].NickName = "S"
    ghenv.Component.Params.Input[inputIndex].Description = "Source plane of object."
    ghenv.Component.Params.Input[inputIndex].Optional = False
    inputIndex+=1
    
    ghenv.Component.Params.Input[inputIndex].Name = "TargetPlane"
    ghenv.Component.Params.Input[inputIndex].NickName = "T"
    ghenv.Component.Params.Input[inputIndex].Description = "Target plane of object."
    ghenv.Component.Params.Input[inputIndex].Optional = False
    inputIndex+=1
    
    #Outputs
    #--------------------------------------------------------------------------------------------
    outputIndex=0
    
    ghenv.Component.Params.Output[outputIndex].Name = "TranslatedGeometry"
    ghenv.Component.Params.Output[outputIndex].NickName = "TG"
    ghenv.Component.Params.Output[outputIndex].Description = "Translated geometry in target plane."
    outputIndex+=1


#Imports
#--------------------------------------------------------------------------------------------
import Rhino.Geometry.Transform as trsf

def MvObjPlnToPln (geo,plnObj,plnDest):
    geo.Transform(trsf.PlaneToPlane(plnObj,plnDest))
    return geo

TG = MvObjPlnToPln(G,S,T)
# ---------- end pl2pl ----------
pl2pl_2 = MoveObjectPlaneToPlane(G=hops_5.Geometry, S=PlaneXY(0, 0, 0), T=cluster)  # -> TG; inputs S: Plane, T: Plane; same code as pl2pl
hops_7 = Hops(
    _Path=concat,
    Names="T",
    Values=Slider(0, range=0..1),
    CacheResultsInMemory=True,
    CacheSolveResults=True,
    RemoteDefinitionLocation="http://127.0.0.1:5000/constructParameters",
    RemoteSolveVersion=(0, 1, 0),
    ShowInput_Enabled=False,
    ShowInput_Path=True,
    SynchronousSolve=True)
hops_8 = Hops(
    _Path=concat,
    Names="T",
    Values=Slider(0, range=0..1),
    CacheResultsInMemory=True,
    CacheSolveResults=True,
    RemoteDefinitionLocation="http://127.0.0.1:5000/constructParameters",
    RemoteSolveVersion=(0, 1, 0),
    ShowInput_Enabled=False,
    ShowInput_Path=True,
    SynchronousSolve=True)
hops_9 = Hops(
    _Path=concat_4,
    Attractor=hops_5.SobjectJson,
    Attracted=hops_6.SobjectJson,
    BiasAttractor=hops_7,
    BiasAttracted=hops_8,
    CacheResultsInMemory=False,
    CacheSolveResults=False,
    RemoteDefinitionLocation="http://127.0.0.1:5000/constructAttraction",
    RemoteSolveVersion=(0, 1, 0),
    ShowInput_Enabled=False,
    ShowInput_Path=True,
    SynchronousSolve=True)  # -> PoseAttracted, AttractorPoint, AttractorPointAttractor, AttractedPoint, AttractorRepresentationAttracted, AttractedRepresentationAttractor
number_slider = Slider(200, range=0..1000)
number_slider_2 = Slider(1, range=0..10)
number_slider_3 = Slider(15, range=0..100)
number_slider_4 = Slider(100, range=0..1000)
pl2pl_3 = MoveObjectPlaneToPlane(G=hops_6.Geometry, S=PlaneXY(0, 0, 0), T=hops_9.PoseAttracted)  # -> TG; inputs S: Plane, T: Plane; same code as pl2pl
merge = Merge(Data1=pl2pl_2, Data2=pl2pl_3)
wires = BrepWireframe(Brep=merge, Density=-1)
vec2pt = Vector2Pt(PointA=cluster_2, PointB=hops_9.AttractorPoint, Unitize=False)  # -> Vector, Length
concat_9 = Concatenate(FragmentA="Attractor", FragmentB=hops)
concat_10 = Concatenate(FragmentA="Attracted", FragmentB=hops_3)
previewplane = PreviewPlane(plane=cluster, axis_length=number_slider)  # -> X_2, Y_2, Z_2
previewplane_2 = PreviewPlane(plane=hops_9.PoseAttracted, axis_length=number_slider)  # -> X_2, Y_2, Z_2
previewplane_3 = PreviewPlane(plane=cluster_2, axis_length=number_slider)  # -> X_2, Y_2, Z_2
previewlw = CustomPreviewLineweights(Geometry=wires, Shader=ColourSwatch(SwatchColor=RGB(0, 0, 0)), Thickness=number_slider_2, Absolute=False)
preview = CustomPreview(Geometry=merge, Material=ColourSwatch(SwatchColor=RGB(255, 0, 0)))
preview_2 = CustomPreview(Geometry=pl2pl, Material=ColourSwatch(SwatchColor=RGBA(255, 0, 0, 32)))
screentext = ScreenOrientedText(
    Text=concat_9,
    Font="Consolas",
    Justification=5,
    Location=cluster,
    SizeFactor=number_slider_3,
    Depth=number_slider_4,
    Absolute=False)
vdisex = VectorDisplayEx(Point=cluster_2, Vector=vec2pt.Vector, Colour=RGB(0, 0, 0), Width=number_slider_2)
screentext_2 = ScreenOrientedText(
    Text=concat_10,
    Font="Consolas",
    Justification=5,
    Location=cluster_2,
    SizeFactor=number_slider_3,
    Depth=number_slider_4,
    Absolute=False)
screentext_3 = ScreenOrientedText(
    Text="Attractor Point",
    Font="Consolas",
    Justification=5,
    Location=hops_9.AttractorPoint,
    SizeFactor=number_slider_3,
    Depth=number_slider_4,
    Absolute=False)
merge_2 = Merge(Data1=previewplane_3.X_2, Data2=previewplane_3.Y_2, Data3=previewplane_3.Z_2)
merge_3 = Merge(Data1=previewplane_2.X_2, Data2=previewplane_2.Y_2, Data3=previewplane_2.Z_2)
number_slider_5 = Slider(600, range=0..1000)
merge_4 = Merge(Data1=merge_3, Data2=merge_2, Data3=merge)
panel_3 = Panel("1")
bbox = BoundingBox(Content=merge_4, Plane=PlaneXY(0, 0, 0), UnionBox=True)  # -> Box, Box_2
dom²num = ConstructDomain²(UMin=0, UMax=number_slider_5, VMin=0, VMax=number_slider_5)
rhinovp = RhinoViewport(N="SemIO", P="7", WD=dom²num, T=False, A=Toggle(True))  # -> F; inputs P: Int32, T: Boolean, A: Boolean
#   port P: 0 = None 1 = Top 2 = Bottom 3 = Left 4 = Right 5 = Front 6 = Back 7 = Perspective 8 = TwoPointPerspective
# ---------- rhinovp: Python ----------
#Component Information
#--------------------------------------------------------------------------------------------
if ghenv.Component.RunCount<2:
    #General
    #--------------------------------------------------------------------------------------------
    __author__ = "Ueli Saluz"
    __version__ = "2022.05.21"
    
    ghenv.Component.Name = "RhinoViewport"
    ghenv.Component.NickName = "RhinoVP"
    ghenv.Component.Description = "Launches or closes a Rhino viewport."
    ghenv.Component.Message = "VER 1.2"
    ghenv.Component.Category = "Display"
    ghenv.Component.SubCategory = "Camera"
    
     #Inputs
    #--------------------------------------------------------------------------------------------
    inputIndex=0
    
    ghenv.Component.Params.Input[inputIndex].Name = "Name"
    ghenv.Component.Params.Input[inputIndex].NickName = "N"
    ghenv.Component.Params.Input[inputIndex].Description = "Name of the viewport"
    ghenv.Component.Params.Input[inputIndex].Optional = False
    inputIndex+=1
    
    ghenv.Component.Params.Input[inputIndex].Name = "ViewportProjection"
    ghenv.Component.Params.Input[inputIndex].NickName = "P"
    ghenv.Component.Params.Input[inputIndex].Description = "0  = None \n1 = Top \n2 = Bottom \n3 = Left \n4 = Right \n5 = Front\n6 = Back\n7 = Perspective\n8 = TwoPointPerspective"
    ghenv.Component.Params.Input[inputIndex].Optional = False
    inputIndex+=1
    
    ghenv.Component.Params.Input[inputIndex].Name = "WindowDomain"
    ghenv.Component.Params.Input[inputIndex].NickName = "WD"
    ghenv.Component.Params.Input[inputIndex].Description = "The domain of the window. The U domain corresponds to X and the V domain to Y."
    ghenv.Component.Params.Input[inputIndex].Optional = False
    inputIndex+=1
    
    ghenv.Component.Params.Input[inputIndex].Name = "TitleVisible"
    ghenv.Component.Params.Input[inputIndex].NickName = "T"
    ghenv.Component.Params.Input[inputIndex].Description = "True if Rhino view title should be visible."
    ghenv.Component.Params.Input[inputIndex].Optional = True
    inputIndex+=1
    
    ghenv.Component.Params.Input[inputIndex].Name = "WallPaperPath"
    ghenv.Component.Params.Input[inputIndex].NickName = "WP"
    ghenv.Component.Params.Input[inputIndex].Description = "The domain of the window. The U domain corresponds to X and the V domain to Y."
    ghenv.Component.Params.Input[inputIndex].Optional = True
    inputIndex+=1
    
    ghenv.Component.Params.Input[inputIndex].Name = "ScaleFactor"
    ghenv.Component.Params.Input[inputIndex].NickName = "S"
    ghenv.Component.Params.Input[inputIndex].Description = "A scale factor that is applied on the window domains."
    ghenv.Component.Params.Input[inputIndex].Optional = True
    inputIndex+=1
    
    ghenv.Component.Params.Input[inputIndex].Name = "Active"
    ghenv.Component.Params.Input[inputIndex].NickName = "A"
    ghenv.Component.Params.Input[inputIndex].Description = "Activate or deactivate the window."
    ghenv.Component.Params.Input[inputIndex].Optional = False
    inputIndex+=1
    
    #Outputs
    #--------------------------------------------------------------------------------------------
    outputIndex=0
    
    ghenv.Component.Params.Output[outputIndex].Name = "Finished"
    ghenv.Component.Params.Output[outputIndex].NickName = "F"
    ghenv.Component.Params.Output[outputIndex].Description = "Sends True when finished. Just to trigger other depending components."
    outputIndex+=1


#Imports
#--------------------------------------------------------------------------------------------
from System import Object, Enum
from Grasshopper import DataTree
import System as sy
import Rhino as rc
import scriptcontext as sc
import clr
import System.Windows.Forms.Control

#Solver - Run with trees to enhance performance drastically
#--------------------------------------------------------------------------------------------
if __name__ == "__main__":
    
    vp = rc.RhinoDoc.ActiveDoc.Views.Find(N, False)
    if A:
        scaleFacor = 1 if S is None else S
        if vp:
            vp.Close()
        
        #The width is 16 pixel and height is 39 too little. Additionally the windows start 8 pixel shifted to the left. Why? I don't know.
        windowRectangle = sy.Drawing.Rectangle(WD.U0*scaleFacor-8,WD.V0*scaleFacor,WD.U.Length*scaleFacor+16,WD.V.Length*scaleFacor+39)
        newView = rc.RhinoDoc.ActiveDoc.Views.Add(N,Enum.ToObject(rc.Display.DefinedViewportProjection, P),windowRectangle,True)
        if T==False:
            newView.TitleVisible = False
        viewport = newView.ActiveViewport
        if WP is not None:
            viewport.SetWallpaper(WP,False)
        
        viewport.ConstructionAxesVisible = False
        viewport.ConstructionGridVisible = False
        viewport.WorldAxesVisible = False
        
    else:
        if vp:
            vp.Close()
    F = True
# ---------- end rhinovp ----------
zoom2bb = ZoomToBoundingBox(N="SemIO", BB=bbox.Box, S=Slider(0, range=-2..2), R=Toggle(True))  # -> F, SBB; inputs BB: Box, R: Boolean
# ---------- zoom2bb: Python ----------
#Component Information
#--------------------------------------------------------------------------------------------
if ghenv.Component.RunCount<2:
    #General
    #--------------------------------------------------------------------------------------------
    __author__ = "Ueli Saluz"
    __version__ = "2022.05.21"
    
    ghenv.Component.Name = "ZoomToBoundingBox"
    ghenv.Component.NickName = "Zoom2BB"
    ghenv.Component.Description = "Zoom the view of a Rhino viewport to a bounding box."
    ghenv.Component.Message = "VER 1.0"
    ghenv.Component.Category = "Display"
    ghenv.Component.SubCategory = "Camera"
    
     #Inputs
    #--------------------------------------------------------------------------------------------
    inputIndex=0
    
    ghenv.Component.Params.Input[inputIndex].Name = "Name"
    ghenv.Component.Params.Input[inputIndex].NickName = "N"
    ghenv.Component.Params.Input[inputIndex].Description = "Name of the viewport"
    ghenv.Component.Params.Input[inputIndex].Optional = False
    inputIndex+=1
    
    ghenv.Component.Params.Input[inputIndex].Name = "BoundingBox"
    ghenv.Component.Params.Input[inputIndex].NickName = "BB"
    ghenv.Component.Params.Input[inputIndex].Description = ""
    ghenv.Component.Params.Input[inputIndex].Optional = False
    inputIndex+=1
    
    ghenv.Component.Params.Input[inputIndex].Name = "ScaleFactor"
    ghenv.Component.Params.Input[inputIndex].NickName = "S"
    ghenv.Component.Params.Input[inputIndex].Description = "A factor for the extension of the bounding box." \
    +"0 means 0 extension, a positive number makes the bounding box larger a negative smaller. The amount is proportional to the length."
    ghenv.Component.Params.Input[inputIndex].Optional = False
    inputIndex+=1
   
    
    ghenv.Component.Params.Input[inputIndex].Name = "Run"
    ghenv.Component.Params.Input[inputIndex].NickName = "R"
    ghenv.Component.Params.Input[inputIndex].Description = "Zoom to the given bounding box."
    ghenv.Component.Params.Input[inputIndex].Optional = False
    inputIndex+=1
    
    #Outputs
    #--------------------------------------------------------------------------------------------
    outputIndex=0
    
    ghenv.Component.Params.Output[outputIndex].Name = "Finished"
    ghenv.Component.Params.Output[outputIndex].NickName = "F"
    ghenv.Component.Params.Output[outputIndex].Description = "Sends True when finished. Just to trigger other depending components."
    outputIndex+=1
    
    ghenv.Component.Params.Output[outputIndex].Name = "ScaledBoundingBox"
    ghenv.Component.Params.Output[outputIndex].NickName = "SBB"
    ghenv.Component.Params.Output[outputIndex].Description = "The scaled bounding box."
    outputIndex+=1


#Imports
#--------------------------------------------------------------------------------------------
from Rhino import RhinoDoc
from Rhino.Geometry import Box

#Solver - Run with trees to enhance performance drastically
#--------------------------------------------------------------------------------------------
if __name__ == "__main__":
    
    vp = RhinoDoc.ActiveDoc.Views.Find(N, False).ActiveViewport
    if R:
        box = BB
        bb = BB.BoundingBox
        bb.Inflate(S*box.X.Length,S*box.Y.Length,S*box.Z.Length)
        vp.ZoomBoundingBox(bb)
        SBB = bb
    F = True
# ---------- end zoom2bb ----------
orbitaround = OrbitAround(geometry=zoom2bb.SBB, longitude=Slider(0, range=0..1), latitude=Slider(0.08, range=0..1), zoom=2, viewportname="SemIO")  # disabled

# ==== cluster PreviewPlane
axis_length = ClusterInput()
plane = ClusterInput()
expression = Expression(Expression="Format(\"{0}, {1}\", x, y)")
axis_length_2 = Number(axis_length)
plane_2 = Plane(plane)
number_slider = Slider(0.05, range=0..1)
deplane = DeconstructPlane(Plane=plane_2)  # -> Origin, XAxis, YAxis, ZAxis
line = LineSDL(Start=deplane.Origin, Direction=deplane.YAxis, Length=axis_length_2)
line_2 = LineSDL(Start=deplane.Origin, Direction=deplane.XAxis, Length=axis_length_2)
line_3 = LineSDL(Start=deplane.Origin, Direction=deplane.ZAxis, Length=axis_length_2)
swatch = ColourSwatch(SwatchColor=RGB(235, 52, 79))
swatch_2 = ColourSwatch(SwatchColor=RGB(0, 166, 157))
swatch_3 = ColourSwatch(SwatchColor=RGB(240, 117, 24))
end = EndPoints(Curve=line_2)  # -> Start, End
end_2 = EndPoints(Curve=line)  # -> Start, End
end_3 = EndPoints(Curve=line_3)  # -> Start, End
multiplication = Multiplication(A=axis_length_2, B=number_slider)
multiplication_2 = Multiplication(A=axis_length_2, B=number_slider)
multiplication_3 = Multiplication(A=axis_length_2, B=number_slider)
X = Line(line_2)
Y = Line(line)
Z = Line(line_3)
amp = Amplitude(Vector=deplane.XAxis, Amplitude=multiplication)
amp_2 = Amplitude(Vector=deplane.YAxis, Amplitude=multiplication_2)
amp_3 = Amplitude(Vector=deplane.ZAxis, Amplitude=multiplication_3)
X_2 = ClusterOutput(X)
Y_2 = ClusterOutput(Y)
Z_2 = ClusterOutput(Z)
move = Move(Geometry=end.End, Motion=amp)  # -> Geometry, Transform
move_2 = Move(Geometry=end_2.End, Motion=amp_2)  # -> Geometry, Transform
move_3 = Move(Geometry=end_3.End, Motion=amp_3)  # -> Geometry, Transform
tag = TextTag(Location=move.Geometry, Text="X", Colour=swatch)
tag_2 = TextTag(Location=move_2.Geometry, Text="Y", Colour=swatch_2)
tag_3 = TextTag(Location=move_3.Geometry, Text="Z", Colour=swatch_3)
preview = CustomPreview(Geometry=line_2, Material=swatch)
preview_2 = CustomPreview(Geometry=line, Material=swatch_2)
preview_3 = CustomPreview(Geometry=line_3, Material=swatch_3)

# ==== cluster Cluster
X = ClusterInput()
Y = ClusterInput()
Z = ClusterInput()
yaw = ClusterInput()
pitch = ClusterInput()
roll = ClusterInput()
yawpitchroll = NAME(yaw=yaw, pitch=pitch, roll=roll)  # -> t
# ---------- yawpitchroll: Python ----------
from Rhino.Geometry import Transform
from math import radians

t = Transform.RotationZYX(radians(yaw),radians(pitch),radians(roll))
# ---------- end yawpitchroll ----------
pt = ConstructPoint(XCoordinate=X, YCoordinate=Y, ZCoordinate=Z)
xy = XYPlane(Origin=Point(0, 0, 0))
transform = Transform(Geometry=xy, Transform=yawpitchroll)
pl_origin = PlaneOrigin(Base=transform, Origin=pt)
pln = Plane(pl_origin)
pln_2 = ClusterOutput(pln)

# ==== cluster OrbitAround: Orbit around a geometry. Replace the mouse with sliders.
geometry = ClusterInput()
longitude = ClusterInput()
latitude = ClusterInput()
zoom = ClusterInput()
viewportname = ClusterInput()
geometry_2 = Geometry(geometry)
longitude_2 = Number(longitude)
latitude_2 = Number(latitude)
zoom_2 = Number(zoom)
viewportname_2 = Text(viewportname)
bbox = BoundingBox(Content=geometry_2, Plane=PlaneXY(0, 0, 0), UnionBox=True)  # -> Box, Box_2
debox = DeconstructBox(Box=bbox.Box)  # -> Plane, X, Y, Z
num = Number(debox.Z)
num_2 = Number(debox.Y)
num_3 = Number(debox.X)
expression = Expression(x=num_3, y=num_2, z=num, u=zoom_2, Expression="Max(x,y,z)*u")
expression_2 = Expression(x=latitude_2, Expression="2*π*(x%1)")
expression_3 = Expression(x=longitude_2, Expression="2*π*(x%1)")
C = Centroids(G=bbox.Box)  # -> C; inputs G: tree
# ---------- C: Python ----------
if ghenv.Component.RunCount<2:
    __author__ = "Ueli Saluz"
    __version__ = "2020.06.07"
    
    ghenv.Component.Name = "Centroids"
    ghenv.Component.NickName = "C"
    ghenv.Component.Description = "Get the centroid of a geometry."
    ghenv.Component.Message = "VER 1.0"
    
    ghenv.Component.Params.Input[0].Name = "Geometry."
    
    ghenv.Component.Params.Output[0].Name = "Centroid."

from Grasshopper import DataTree
from System import Object
from Rhino.Geometry.AreaMassProperties import Compute as AMP

if __name__ == "__main__":
    C = DataTree[Object]()
    for path in G.Paths:
        for geometry in G.Branch(path):
            try:
                amp = AMP(geometry)
                centroid = amp.C
            except Exception:
                centroid = geometry.Center
            C.Add(centroid,path)
# ---------- end C ----------
pt = ConstructPoint(XCoordinate=expression_3, YCoordinate=expression_2, ZCoordinate=0)
sph = Sphere(Base=C, Radius=expression)
evalsrf = EvaluateSurface(Surface=sph, Point=pt)  # -> Point, Normal, Frame
deplane = DeconstructPlane(Plane=evalsrf.Frame)  # -> Origin, XAxis, YAxis, ZAxis
setview = SetView(VpName=viewportname_2, Location=evalsrf.Point, Target=C, Up=deplane.YAxis)  # inputs Location: Point3d, Target: Point3d, Up: Vector3d
# ---------- setview: Python ----------
if ghenv.Component.RunCount<2:
    __author__ = "Ueli Saluz"
    __version__ = "2020.06.07"
    
    ghenv.Component.Name = "SetView"
    ghenv.Component.NickName = "SetView"
    ghenv.Component.Description = "Set a specific viewport."
    ghenv.Component.Message = "VER 1.0"
    
    ghenv.Component.Params.Input[0].Description = "Select a specific viewport. Otherwise the active viewport will be chosen."
    ghenv.Component.Params.Input[1].Description = "Location of the camera."
    ghenv.Component.Params.Input[2].Description = "Target of the camera."
    ghenv.Component.Params.Input[3].Description = "Up vector of the camera. By default it will be unit z vector."

from Rhino import RhinoDoc
from Rhino.Geometry import Vector3d

def setView(target,location,up = Vector3d(0,0,1), vpName = ""):
    if vpName:
        view = RhinoDoc.ActiveDoc.Views.Find(vpName, False)
    else:
        view = RhinoDoc.ActiveDoc.Views.ActiveView
    vp = view.ActiveViewport
    vp.SetCameraLocation(location,False)
    vp.SetCameraTarget(target,False)
    vp.SetCameraDirection(target-location,False)
    vp.CameraUp = up

if __name__ == "__main__":
    if not VpName:
        VpName = ""
    if not Up:
        Up = Vector3d(0,0,1)
    Complete = setView(Target,Location,Up,VpName)
# ---------- end setview ----------
